# Grasshopper definition snap_fit.gh (Grasshopper 1.0.7)

crv = Curve([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])
crv_2 = Curve([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])
crv_3 = Curve([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])
path = FilePath("C:\IBOIS57\_Code\Software\Python\compas_wood\backend\src\wood\dataset\type_plates_name_side_to_top_pairs.xml")
panel = Panel(path)
partition = PartitionList(List=crv, Size=Slider(2, range=0..10))
loft = Loft(Curves=partition, Options={Adjust=False, Closed=False, LoftEnds=0, LoftSimp=0, LoftType=0, Rebuild=10, Refit=0.01})
polyline_to_cgal_polylines = PolylineToCGAL_Polylines(x=flatten(crv_2))  # -> out, A; inputs x: list of Polyline
# ---------- polyline_to_cgal_polylines: C# ----------
    var txt = new List<string>(x.Count);
    txt.Add("std::vector<CGAL_Polyline> polylines;");
    
    int count = 0;
    foreach(Polyline pline in x){
      txt.Add(" ");
      txt.Add(string.Format("CGAL_Polyline p{0} ",count)+"{");
      
      foreach(Point3d p in pline)
        txt.Add(string.Format("IK::Point_3({0}, {1}, {2}),",p.X,p.Y,p.Z));
      
      txt.Add("};");
      count++;
    }
    
    txt.Add(" ");
    count = 0;
    foreach(Polyline pline in x){

      txt.Add(string.Format("polylines.push_back (p{0});", count) );
      count++;
    }
    
    A = txt;
# ---------- end polyline_to_cgal_polylines ----------
polyline_to_cgal_polylines_2 = PolylineToCGAL_Polylines(x=flatten(crv_3))  # -> out, A; inputs x: list of Polyline; same code as polyline_to_cgal_polylines
cap = CapHoles(Brep=loft)
polylines_to_xml = Polylines_to_XML(plines=partition, path=path)  # -> out, A; inputs plines: tree of Polyline, path: String
# ---------- polylines_to_xml: C# usings ----------
using System.Linq;
using System.Xml;
# ---------- polylines_to_xml: C# ----------
       this.Component.Message = "Polylines_to_XML";
   
    /////////////////////////////////////////////////////////////////////////////////////////////////////////////////////////////////////////////
    //Create document
    /////////////////////////////////////////////////////////////////////////////////////////////////////////////////////////////////////////////
    XmlWriter xmlWriter = XmlWriter.Create(path);
    xmlWriter.WriteStartDocument();
    xmlWriter.WriteStartElement("input_polylines");
    /////////////////////////////////////////////////////////////////////////////////////////////////////////////////////////////////////////////
    //Start document
    /////////////////////////////////////////////////////////////////////////////////////////////////////////////////////////////////////////////
    foreach(Polyline pline in plines.AllData()){
      xml_polyline(ref xmlWriter, pline, "Polyline");
    }

    /////////////////////////////////////////////////////////////////////////////////////////////////////////////////////////////////////////////
    //Close document
    /////////////////////////////////////////////////////////////////////////////////////////////////////////////////////////////////////////////
    xmlWriter.WriteEndDocument();
    xmlWriter.Close();
# ---------- polylines_to_xml: C# additional code ----------
  public void xml_polyline(ref XmlWriter xmlWriter, Polyline pline, string name){
    xmlWriter.WriteStartElement(name);
    foreach(Point3d p in pline){

      xmlWriter.WriteStartElement("point");

      xmlWriter.WriteStartElement("x");
      xmlWriter.WriteString(p.X.ToString());
      xmlWriter.WriteEndElement();

      xmlWriter.WriteStartElement("y");
      xmlWriter.WriteString(p.Y.ToString());
      xmlWriter.WriteEndElement();

      xmlWriter.WriteStartElement("z");
      xmlWriter.WriteString(p.Z.ToString());
      xmlWriter.WriteEndElement();

      xmlWriter.WriteEndElement();
    }
    xmlWriter.WriteEndElement();
  }
# ---------- end polylines_to_xml ----------
panel_2 = Panel(polyline_to_cgal_polylines_2.A)
panel_3 = Panel(polyline_to_cgal_polylines.A)
