# Grasshopper definition development_optimization.gh (Grasshopper 1.0.7)
# plug-ins: compas_wood

arch_number = Slider(23, range=1..23)
chevron_surfaces = Chevron_surfaces([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])
item = ListItem(List=chevron_surfaces, Index=expr("x-1", arch_number), Wrap=True)

# ---- group: chevron
chevron = Chevron(
    Surface=item,
    U_divisions=Slider(4, range=1..20),
    V_division_dist=Slider(900, range=900..1000),
    Shift=Slider(0.5, range=0.5..1),
    Scale=Slider(0.05799, range=0.05..0.06))

# ---- group: chevron_plates
chevron_plates = Chevron_plates(
    Mesh=chevron,
    Edge_rotation=Slider(1, range=0..10),
    Edge_offset=Slider(0.5, range=0..2.5),
    Box_height=Slider(760, range=100..1000),
    Top_plate_inlet=Slider(80, range=0..100),
    Plate_thickness=Slider(40, range=1..40),
    Ortho=True)  # -> Data, Dir

# ---- group: joints_params
joints_params = Joints_params(
    ss_e_ip_len=Slider(300, range=30..3000),
    ss_e_ip_shift=Slider(0.5, range=0..1),
    ss_e_ip_type=Slider(9, range=1..9),
    ss_e_op_len=Slider(450, range=30..3000),
    ss_e_op_shift=Slider(0.65, range=0..1),
    ss_e_op_type=Slider(10, range=10..19),
    ts_e_p_len=Slider(450, range=30..3000),
    ts_e_p_shift=Slider(0.5, range=0..1),
    ts_e_p_type=Slider(21, range=20..29),
    cr_c_ip_len=Slider(300, range=30..3000),
    cr_c_ip_shift=Slider(0.5, range=0..1),
    cr_c_ip_type=Slider(30, range=30..39),
    tt_e_p_len=Slider(300, range=30..3000),
    tt_e_p_shift=Slider(0.5, range=0..1),
    tt_e_p_type=Slider(40, range=40..49),
    ss_e_r_len=Slider(300, range=30..3000),
    ss_e_r_shift=Slider(0.5, range=0..1),
    ss_e_r_type=Slider(50, range=50..59))

# ----
number_slider = Slider(300, range=30..3000)
solver = Solver(Data=chevron_plates.Data, Join_p=joints_params, Find=0, Get=4)
input_get = Input_get(Data=solver)  # -> simplify(Plines), Insertion_vectors, Joints_per_face, Three_valence, Adjacency

crv = Curve(chevron_plates.Dir)

b = Panel("""300
1.0
60""")
ss_e_r = Panel("""300
0.5
58""")
cr_c_ip = Panel("""300
0.5
30""")
tt_e_p = Panel("""6
0.95
40""")
# JOINT PARAMETERS
ss_e_ip = Panel("""300
0.5
9""")
ss_e_op = Panel("""450
0.65
10""")
ts_e_p = Panel("""450
0.5
21""")
joint_parameters = Joint_parameters(ss_e_ip=ss_e_ip, ss_e_op=ss_e_op, ts_e_p=ts_e_p, cr_c_ip=cr_c_ip, tt_e_p=tt_e_p, ss_e_r=ss_e_r, b=b)  # -> joint_p; inputs ss_e_ip: list, ss_e_op: list, ts_e_p: list, cr_c_ip: list, tt_e_p: list, ss_e_r: list, b: list
#   port ss_e_ip: side-to-side in-plane joint parameters
# ---------- joint_parameters: Python ----------
__author__ = "petras vestartas"
__version__ = "2023.03.29"

"""
Output joint parameters in one list
"""
from ghpythonlib.componentbase import executingcomponent as component


class joint_parameters_component(component):
    def RunScript(
        self,
        _ss_e_ip,
        _ss_e_op,
        _ts_e_p,
        _cr_c_ip,
        _tt_e_p,
        _ss_e_r,
        _b

    ):
        
        joint_parameters = [
            300, 0.5, 3,   # 1-9 ss_e_ip (side-to-side edge in-plane)
            50, 0.64, 15,  # 10-19 ss_e_op (side-to-side edge out-of-plane)
            450, 0.5, 20,  # 20-29 ts_e_p (top-to-side edge plane)
            300, 0.5, 30,  # 30-39 cr_c_ip (cross cutting in-plane)
            6, 0.95, 40,   # 40-49 tt_e_p  (top-to-top edge plane)
            300, 0.5, 58,  # 50-59 ss_e_r (side-to-side edge rotated)
            300, 1.0, 60   # 60-69 b (boundary)
        ]

        for i in range(len(_ss_e_ip)):
            joint_parameters[0*3+i] = _ss_e_ip[i]

        for i in range(len(_ss_e_op)):
            joint_parameters[1*3+i] = _ss_e_op[i]

        for i in range(len(_ts_e_p)):
            joint_parameters[2*3+i] = _ts_e_p[i]

        for i in range(len(_cr_c_ip)):
            joint_parameters[3*3+i] = _cr_c_ip[i]

        for i in range(len(_tt_e_p)):
            joint_parameters[4*3+i] = _tt_e_p[i]

        for i in range(len(_ss_e_r)):
            joint_parameters[5*3+i] = _ss_e_r[i]

        for i in range(len(_b)):
            joint_parameters[6*3+i] = _b[i]

        _joint_p = joint_parameters

        return _joint_p
# ---------- end joint_parameters ----------
# C++ - PINVOKE - .NET RHINO - 23 ms
# 
# MEASURE THE TIME FOR:
# compas_wood conversion 1
# c++ code execution for pybind11
# compas_wood conversion 2
# rpc transfer
# compas_wood to rhino conversion
panel = Panel(joint_parameters)

crv_2 = Curve([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])
# EARS
crv_3 = Curve([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])
crv_4 = Curve(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)
crv_5 = Curve([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])
crv_6 = Curve(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)
crv_7 = Curve([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])
entwine = Entwine(Branch00=crv_3, Branch01=crv_4, Branch02=crv_2, FlattenInputs=True)
entwine_2 = Entwine(Branch00=crv_5, Branch01=crv_6, Branch02=crv_7, FlattenInputs=True)
ears = Ears(p0=entwine, p1=entwine_2, radius=Slider(4, range=0..1000), notch_type=Slider(2, range=0..4), union=Toggle(True))  # -> lines, lines_corners, lines_horizontal, offset0, offset1, planes, cut_extrusions; inputs p0: tree of Curve, p1: tree of Curve, notch_type: Int32, union: Boolean
#   port p0: a data-tree of polyline pairs with holes
#   port p1: a data-tree of polyline pairs with holes
#   port radius: notch radius that is equal to cutting tool radius
#   port notch_type: 0 - none, 1 - diagonal, 2 - translation
#   port union: get cutting elements for boolean difference and union
#   port lines_corners: lines which shows the correners from where the notch starts
#   port lines_horizontal: notches are represented as horizontal lines that can be used for milling
#   port offset0: offset outrline for cutting without notches
#   port offset1: offset outrline for cutting without notches
#   port planes: element plane that can be used for orientation
#   port cut_extrusions: breps that can be used for boolean difference
# ---------- ears: Python ----------
"""get joints ids and connections areas between elements"""

__author__ = "petras vestartas"
__version__ = "2023.04.01"


from ghpythonlib.componentbase import executingcomponent as component

import Rhino.RhinoDoc
import Rhino.RhinoApp
from Rhino.Geometry import Polyline
from Rhino.Geometry import Plane
from Rhino.Geometry import Point3d
from Rhino.Geometry import Vector3d
from Rhino.Geometry import Line
from Rhino.Geometry import Transform
from Rhino.Geometry import Arc
from Rhino.Geometry import Brep
from Rhino.Geometry import Curve
import math
from Rhino.Geometry.Intersect.Intersection import PlanePlane
from Rhino.Geometry.Intersect.Intersection import LinePlane
from Rhino.Geometry.Intersect.Intersection import BrepPlane
import Grasshopper
from ghpythonlib import treehelpers


class ears(component):
            
    def to_polyline_from_cp(self, curve):
        
        polyline = Polyline() 
        result, polyline1 = curve.TryGetPolyline()
                
        if (result == False):
                    
            nurbsCurve = curve.ToNurbsCurve()  
            point3dArray = []
                    
            for i in range(nurbsCurve.Points.Count):
                result, pt = nurbsCurve.Points.GetPoint(i)
                point3dArray.append(pt)
                    
            polyline1 = Polyline(point3dArray)  
            nurbsCurve = polyline1.ToNurbsCurve()  
            result, polyline1 = nurbsCurve.TryGetPolyline()  
                    
            polyline1.CollapseShortSegments(0.01) 
                    
            polyline1 = Polyline(polyline1)  
            polyline = polyline1  
                    
        else:
            polyline1.CollapseShortSegments(0.01)  
            polyline = polyline1  
                
        return polyline


    def offset_parallelograms(self, x, y, radius) :
        """offset outlines by intersecting side planes
                
        Parameters
        ----------
        x : first closed outline
        y : second closed outline
        radius : offset distance that normally corresponds to the tool radius
                
        Returns
        -------
        tuple(polyline0, polyline1)
            two outlines
        bool
            if polylines are closed
        """
                
        if(x.Count < 2 or y.Count<2):
            print("WARNING empty polylines")
            return
        
        ###############################################################################
        # Get edge planes that are offseted
        ###############################################################################
        
        offset_planes = []
        for i in range(x.Count-1):
            c = (x[i] + x[i + 1]) * 0.5
            XAxis = y[i] - y[i + 1] if x[i].DistanceTo(x[i + 1]) < 0.01 else x[i] - x[i + 1]
            YAxis = x[i] - y[i]
            ZAxis = Vector3d.CrossProduct(XAxis, YAxis)
            ZAxis.Unitize()
            plane =  Plane(c + ZAxis * radius, XAxis, YAxis)
            offset_planes.Add(plane)
        
        
        ###############################################################################
        # Intersect planes one by one
        ###############################################################################
        
        result, fit_plane0 = Plane.FitPlaneToPoints(x)
        result, fit_plane1 = Plane.FitPlaneToPoints(y)
        offset_polyline0 = Polyline()
        offset_polyline1 = Polyline()
        
        
        closed = x[0].DistanceToSquared( x[x.Count-1]) < 0.0001
        for i in range(offset_planes.Count) :
            result, l = PlanePlane(offset_planes[(offset_planes.Count+(i-1))% offset_planes.Count], offset_planes[i])
            result, types_of_notches_per_point = LinePlane(l, fit_plane0)
            offset_polyline0.Add(l.PointAt(types_of_notches_per_point))
            result, types_of_notches_per_point = LinePlane(l, fit_plane1)
            offset_polyline1.Add(l.PointAt(types_of_notches_per_point))
        
        
        if (closed == False) :
            
            l = Line.Unset
            result, l = PlanePlane(fitPlane0, offset_planes[0])
            offset_polyline0.Insert(0, l.ClosestPoint(x[0], False))
            result, l = PlanePlane(fitPlane0, offset_planes[offset_planes.Count - 1])
            offset_polyline0.Add(l.ClosestPoint(x[x.Count - 1], False))
            
            result, l = PlanePlane(fitPlane1, offset_planes[0])
            offset_polyline1.Insert(0, l.ClosestPoint(y[0], False))
            result, l = PlanePlane(fitPlane1, offset_planes[offset_planes.Count - 1])
            offset_polyline1.Add(l.ClosestPoint(y[y.Count - 1], False))
        else :
            offset_polyline0.Add(offset_polyline0[0])
            offset_polyline1.Add(offset_polyline1[0])
        
        
        ###############################################################################
        # Output
        ###############################################################################
        return offset_polyline0, offset_polyline1, closed

    def align_plane(self, plane, v):
        
        p = Plane(plane)
        
        result, parameterAlongXDirection, parameterAlongYDirection = p.ClosestParameter(p.Origin + v)
        angle = math.atan2(parameterAlongXDirection, parameterAlongYDirection)
        p.Rotate(-angle + 1.5707963267949, p.ZAxis, p.Origin)
        
        return p

    def vector_projection(self,v0, v1, extendV1 = False) :
        
        v0L = v0.Length
        v1L = v1.Length
        v0.Unitize()
        v1.Unitize()
        dotProduct = v0 * v1
        v0ProjectionLen = v0L * dotProduct
        if (extendV1):
            return v1 * (v0ProjectionLen + v1L)
        return v1 * v0ProjectionLen

    def get_leveled_vector(self, vector, vertical_height):
        
        dir = Vector3d(vector)
        dir.Unitize()
        angle = Vector3d.VectorAngle(dir, Vector3d(0, 0, 1))
        inclined_offset_by_vertical_distance = vertical_height * math.tan(angle)
        dir = dir*inclined_offset_by_vertical_distance

        return dir;


    def notches_lines(self, plines0, plines1, plines0_offset, plines1_offset, _radius, types_of_notches_per_point, offset_distances, is_closed, border):
        """create drilling lines that represent notches
                
        Parameters
        ----------
        plines0_offset[i], plines1_offset[i], _radius, notch_types, offset_distances
        plines0 : bottom offseted outlines by plane to plane inersection
        plines1 : top offseted outlines by plane to plane inersection
        radius : offset distance
        types_of_notches_per_point : type of notch: bisector, translation u, trasnlation v, rounding, none
        offset_distances : perpendicular distance between corner lines and offset lines
        is_closed : check if the offseted outline is closed  
        border : bool if border or hole
        Returns
        -------
        list(Line)
            drilling lines
        list(Line)
            drilling lines of corners that notches belongs to
        """
        
        ###############################################################################
        # Copy the offset polylines
        # Remove end point if the polyline is closed
        ###############################################################################
        xA_ = Polyline(plines0)
        xB_ = Polyline(plines1)
        xA = Polyline(plines0_offset)
        xB = Polyline(plines1_offset)
        
        #Rhino.RhinoDoc.ActiveDoc.Objects.AddBox(Rhino.Geometry.Box(xA_.BoundingBox))
        #Rhino.RhinoDoc.ActiveDoc.Objects.AddPolyline(xA)
        #Rhino.RhinoDoc.ActiveDoc.Objects.AddBox(Rhino.Geometry.Box(xB_.BoundingBox))
        
        if(is_closed):
            xA_.RemoveAt(xA_.Count - 1)
            xB_.RemoveAt(xB_.Count - 1)
            xA.RemoveAt(xA.Count - 1)
            xB.RemoveAt(xB.Count - 1)
        
        ###############################################################################
        # Output lists
        ###############################################################################
        l0_corners =  [] # fillet
        l0 =  []
        l1 =  [] # fillet
        l2 =  [] # fillet
        plines = []
        planes = []
        
        ###############################################################################
        # create plane to plane transformation for geometry rotated in 3D
        ###############################################################################
        result, base_plane = Plane.FitPlaneToPoints(xA)
        if (base_plane.DistanceTo(xB[0]) < 0.0):
            base_plane.Flip()
        to_xy = Transform.PlaneToPlane(base_plane, Plane.WorldXY)
        
        ###############################################################################
        # For notches or fillet, if fillet twice bigger radius is needed
        # also see this if statement if (types_of_notches_per_point[0] == 4 && angle_ > 0) : because corner is  inversed
        ###############################################################################
        fillet = False
        R_ = _radius * 2 if types_of_notches_per_point[0] == 4 else _radius
        notchStart = True
        
        for i in range(0, xA.Count) :
            
            ###############################################################################
            # Get vertical lines
            ###############################################################################
            normal = Line(xA[i], xB[i])
            n = xA.Count
            next = (i + 1) % n
            nextNext = (i + 2) % n
            prev = (((i - 1) % n) + n) % n
            
            p0a = xA[i]
            p1a = xA[next]
            p2a = xA[prev]
            p3a = xA[nextNext]
            
            p0b = xB[i]
            p1b = xB[next]
            p2b = xB[prev]
            p3b = xB[nextNext]
            
            normal1 = Line(xA[next], xB[next])
            normal2 = Line(xA[prev], xB[prev])
            ###############################################################################
            # Measure Concavity
            ###############################################################################
            cornera =  Polyline( [ p2a, p0a, p1a ] )
            cornerb =  Polyline( [ p2b, p0b, p1b ] )
            
            cornera.Transform(Transform.PlaneToPlane( Plane(p0a, normal.Direction), Plane.WorldXY))
            nextEdge = cornera.SegmentAt(0).Direction
            previousEdge = cornera.SegmentAt(1).Direction
            
            angle_ = ((math.atan2(nextEdge.X, nextEdge.Y) - math.atan2(previousEdge.X, previousEdge.Y) + math.pi * 2) % (math.pi * 2)) -math.pi
            
            if (types_of_notches_per_point[0] == 4 and angle_ > 0):
                l0_corners.Add(Line.Unset)
                l0.Add(Line.Unset)
                l1.Add(Line.Unset)
                l2.Add(Line.Unset)
                continue
            
            elif (types_of_notches_per_point[0] != 4 and angle_ < 0) :
                l0_corners.Add(Line.Unset)
                l0.Add(Line.Unset)
                l1.Add(Line.Unset)
                l2.Add(Line.Unset)
                continue
            
            
            ###############################################################################
            # Get Perpependicular points
            # Intersect current and neighbor lines
            ###############################################################################
            
            
            
            # Create plane for intersection of neighbor lines
            result, fit_plane1 = Plane.FitPlaneToPoints( [normal.To, normal1.To, normal2.To] )
            normalPl =  Plane(normal.From, fit_plane1.ClosestPoint(normal.From) - normal.From)
            f0, t = LinePlane(normal, normalPl)
            p0a = normal.PointAt(t)
            f1, t = LinePlane(normal1, normalPl)
            p1a = normal1.PointAt(t)
            f2, t = LinePlane(normal2, normalPl)
            p2a = normal2.PointAt(t)
            
            
            ###############################################################################
            # Compute offset vectors on perpedicular points
            # Error here, with v0 and v1 orientaton, must be rotated  90 deg
            ###############################################################################
            v0 = p0a - p1a
            v1 = p0a - p2a
            
            v0.Unitize()
            v1.Unitize()
            
            ###############################################################################
            # Depending on angle the offset changes, sin gives this distance value
            ###############################################################################
            angle = Vector3d.VectorAngle(v0, v1,  Plane(p0a, v0, v1))
            radius = R_ * ((1 / math.atan(angle)) )
            radius = -offset_distances[i].Length
            # translation
            radius *= -1
            
            ###############################################################################
            # TYPE A Notch - Line Directions A-B
            ###############################################################################
            local_cornera_ =  Polyline( [ xA_[prev], xA_[i], xA_[next] ] )
            local_cornerb_ =  Polyline( [ xB_[prev], xB_[i], xB_[next] ] )
            local_cornera =  Polyline( [ xA[prev], xA[i], xA[next]  ] )
            local_cornerb =  Polyline( [ xB[prev], xB[i], xB[next] ] )
            pl0 = self.align_plane(normalPl, v0)
            pl1 = self.align_plane(normalPl, v1)
            extension0 = 0
            extension1 = 0
            # for sharp angles extension is needed
            """
            extension0 = self.vector_projection(v0 * radius, v1 * radius).Length if angle < (math.pi * 0.5) else 0
            extension1 = self.vector_projection(v1 * radius, v0 * radius).Length if angle < (math.pi * 0.5) else 0
            extension0 *= 1
            extension1 *= 1
            
            normalXAxis0 =  Line(xA[i] + pl0.XAxis * (radius + extension0), xB[i] + pl0.XAxis * (radius + extension0))
            normalXAxis1 =  Line(xA[i] + pl1.XAxis * (radius + extension1), xB[i] + pl1.XAxis * (radius + extension1))
            """
            #Rhino.RhinoDoc.ActiveDoc.Objects.AddPolyline(cornera) 
            normalXAxis0 = Line(local_cornera.SegmentAt(0).ClosestPoint(local_cornera_[1],False),local_cornerb.SegmentAt(0).ClosestPoint(local_cornerb_[1],False))
            normalXAxis1 = Line(local_cornera.SegmentAt(1).ClosestPoint(local_cornera_[1],False),local_cornerb.SegmentAt(1).ClosestPoint(local_cornerb_[1],False))
            dist0 = xA.ClosestPoint(normalXAxis0.From).DistanceTo(normalXAxis0.From)
            dist1 = xA.ClosestPoint(normalXAxis1.From).DistanceTo(normalXAxis1.From)
            border_or_hole = dist0<dist1 if border else dist0>dist1 
            if(border_or_hole):
                normalXAxis0 = normalXAxis1
            else:
                normalXAxis1 = normalXAxis0
            # Rhino.RhinoDoc.ActiveDoc.Objects.AddLine( normalXAxis0 )
            # Rhino.RhinoDoc.ActiveDoc.Objects.AddLine( normalXAxis1 )
            ###############################################################################
            # TYPE B Notch -  Diaognal
            ###############################################################################
            bisectorDir = offset_distances[i]
            
            pl2normalXAxis2Fillet = self.align_plane(normalPl, bisectorDir)
            length = bisectorDir.Length
            normalXAxis2 = Line(xA[i] + bisectorDir, xB[i] + bisectorDir)
            
            # Rhino.RhinoDoc.ActiveDoc.Objects.AddLine( normalXAxis2 )
            
            ###############################################################################
            # TYPE C Notch -  Fillet
            ###############################################################################
            bisectorDirFillet = (pl0.XAxis * radius + pl1.XAxis * radius)
            pl2 = self.align_plane(normalPl, bisectorDirFillet)
            lengthFillet = bisectorDir.Length
            bisectorDirFillet *= -(length) / length
            
            normalXAxis2Fillet = Line(xA[i] + bisectorDirFillet * ((length - R_) / length), xB[i] + bisectorDirFillet * ((length - R_) / length))
            normalXAxis2FilletCenter = Line(xA[i] + bisectorDirFillet, xB[i] + bisectorDirFillet)
            normalXAxis2Fillet0 = Line(normalXAxis2FilletCenter.From + pl0.XAxis * (radius + extension0), normalXAxis2FilletCenter.To + pl0.XAxis * (radius + extension0))
            normalXAxis2Fillet1 = Line(normalXAxis2FilletCenter.From + pl1.XAxis * (radius + extension0), normalXAxis2FilletCenter.To + pl1.XAxis * (radius + extension0))
            # Rhino.RhinoDoc.ActiveDoc.Objects.AddLine( normalXAxis2Fillet ) 
            # Rhino.RhinoDoc.ActiveDoc.Objects.AddLine( normalXAxis2FilletCenter ) 
            # Rhino.RhinoDoc.ActiveDoc.Objects.AddLine( normalXAxis2Fillet0 ) 
            # Rhino.RhinoDoc.ActiveDoc.Objects.AddLine( normalXAxis2Fillet1 ) 
            
            ###############################################################################
            # Output
            ###############################################################################
            planes.Add(pl0)
            planes.Add(pl1)
            planes.Add(pl2)
            
            lastFlag = False
            
            l0_corners.append(Line(xA[i],xB[i]))
            if (len(types_of_notches_per_point) == 1):
                if (types_of_notches_per_point[0]==2 or types_of_notches_per_point[0]==3) :
                    flag = p0.DistanceToSquared(p1) < p0.DistanceToSquared(p2) if types_of_notches_per_point[0] == 3 else  p0.DistanceToSquared(p1) > p0.DistanceToSquared(p2)
                    if (flag):
                        l0.Add(normalXAxis0)
                    else:
                        l0.Add(normalXAxis1)
                    
                elif (types_of_notches_per_point[0]==1) :
                    l0.Add(normalXAxis2)
                    
                elif (types_of_notches_per_point[0]==4) :
                    fillet = True
                    l0.Add(normalXAxis2Fillet0)
                    l1.Add(normalXAxis2Fillet)
                    l2.Add(normalXAxis2Fillet1)
                    
                elif (types_of_notches_per_point[0]==5 or types_of_notches_per_point[0]==6) :
                    if (i % 2 == 1):
                        lastFlag = not lastFlag
                    if (types_of_notches_per_point[0] == 6):
                        lastFlag = not lastFlag
                    
                    if (lastFlag):
                        l0.Add(normalXAxis0)
                    else:
                        l0.Add(normalXAxis1)
                    
                else:
                    l0.Add(Line.Unset)
                
            else:
                
                if (types_of_notches_per_point[i % len(types_of_notches_per_point)] == 2):
                    l0.Add(normalXAxis0)
                
                elif (types_of_notches_per_point[i % len(types_of_notches_per_point)] == 3):
                    l0.Add(normalXAxis1)
                
                elif (types_of_notches_per_point[i % len(types_of_notches_per_point)] == 4):
                    fillet = True
                    l0.Add(normalXAxis2Fillet0)
                    l1.Add(normalXAxis2Fillet)
                    l2.Add(normalXAxis2Fillet1)
                
                elif (types_of_notches_per_point[i % len(types_of_notches_per_point)] == 1):
                    l0.Add(normalXAxis2)
                
                else:
                    l0.Add(Line.Unset)
        
        # for i in l0: 
        #     Rhino.RhinoDoc.ActiveDoc.Objects.AddLine(i)
        
        ###############################################################################
        # Add Notches to a Pair of Polylines
        ###############################################################################
        lines = []
        lines_corners = []
        lines_horizontal = []
        result, fitPlane = Plane.FitPlaneToPoints(xA)
        result, fitPlaneB = Plane.FitPlaneToPoints(xB)
        # Rhino.RhinoDoc.ActiveDoc.Objects.AddPolyline(xA)
        # Rhino.RhinoDoc.ActiveDoc.Objects.AddPolyline(xB)
        
        xA_Notch = Polyline()
        xB_Notch = Polyline()
        
        extensions = []
        is_below = []
        
        for i in range(xA.Count):
            
            # Extend bottom line to compensate drilling bit thickness and angle
            extensionV = xA[i] - xB[i]
            extension = abs(math.tan(Vector3d.VectorAngle(extensionV, fitPlane.ZAxis)) * R_)
            extensionV.Unitize()
            
            # Move tool-path below surface
            extensionV = extensionV * extension
            extensions.append( extensionV )
            
            next = (i+1)%xA.Count
            prev = (xA.Count+(i-1))%xA.Count
            
            # Check direction of inclined cut, the check is made according to XY plane
            side_plane = Plane(xA[i], xB[i], xA[next])
            
            mid_0 = 0.5 * (xA[i] + xA[next])
            mid_1 = 0.5 * (xB[i] + xB[next])
            segment = Line(xB[i], xB[next])
            
            tool_direction =  Line(mid_0, segment.ClosestPoint(mid_0, False))
            #Rhino.RhinoDoc.ActiveDoc.Objects.AddLine(segment)
            # objects.Add(tool_direction)
            side_plane.Transform(to_xy)
            
            is_below.append(0)
            if (side_plane.Normal.Z < -0.01):
                is_below[i] = -1
            elif (side_plane.Normal.Z > 0.01):
                is_below[i] = 1
                extensions[i] *= -1
            else:
                extensions[i] *= 0
        
        count = 0
        
        # for i in l0: 
        #     Rhino.RhinoDoc.ActiveDoc.Objects.AddLine(i)
        
        for i in range (xA.Count) :
            
            # Extend bottom line to compensate drilling bit thickness and angle
            extensionV = extensions[i]
            next = (i+1)%xA.Count
            prev = (xA.Count+(i-1))%xA.Count
            # Rhino.RhinoDoc.ActiveDoc.Objects.AddLine(l0[count]) 
            # Fillet corner
            if (fillet):
                if (l0[count] != Line.Unset) :
                    # Rhino.RhinoDoc.ActiveDoc.Objects.AddLine(l0[count])    
                    # Rhino.RhinoDoc.ActiveDoc.Objects.AddLine(l1[count])  
                    # Rhino.RhinoDoc.ActiveDoc.Objects.AddLine(l2[count]) 
                    result, t = LinePlane(l0[count], fitPlane)
                    xA_Notch.Add(l0[count].PointAt(t) + extensionV*0)
                    # result, t = LinePlane(l1[count], fitPlane)
                    # xA_Notch.Add(l1[count].PointAt(t) + extensionV)
                    result, t = LinePlane(l2[count], fitPlane)
                    xA_Notch.Add(l2[count].PointAt(t) + extensionV*0)
                    
                    result, t = LinePlane(l0[count], fitPlaneB)
                    xB_Notch.Add(l0[count].PointAt(t))
                    # result, t = LinePlane(l1[count], fitPlaneB)
                    # xB_Notch.Add(l1[count].PointAt(t))
                    result, t = LinePlane(l2[count], fitPlaneB)
                    xB_Notch.Add(l2[count].PointAt(t))
                
                else: 
                    xA_Notch.Add(xA[i] + extensionV*0)
                    xB_Notch.Add(xB[i])
            
            
            # Notch corner
            else :
                if(l0[count] != Line.Unset):
                    lines.Add(l0[count])
                    lines_corners.Add(l0_corners[count])
            
            
            
            count = count + 1 
            
        ###############################################################################
        # Cut lines by bottom and top planes and extend by the radius
        ###############################################################################
            
        for i in range(len(lines)):
            #cut the lines by top and bottom planes
            result, t = LinePlane(lines[i], fitPlane)
            new_point_0 = lines[i].PointAt(t)
            result, t = LinePlane(lines[i], fitPlaneB)
            new_point_1 = lines[i].PointAt(t)
            
            # get extension direction
            l_temp = Line(new_point_0,new_point_1)
            extension_dir = new_point_1-new_point_0
            extension_dir.Unitize()
            l_temp.Transform(to_xy)
            extension_vector = self.get_leveled_vector(l_temp.Direction,_radius)
            extension_dir = extension_dir * extension_vector.Length
            
            # extend the line and update the line
            # lines[i] = Line(new_point_0,new_point_1)
            lines[i] = Line(new_point_0-extension_dir*1,new_point_1+extension_dir*1)
            
        for i in range(len(lines_corners)):
            #Rhino.RhinoDoc.ActiveDoc.Objects.AddLine(lines_corners[i])
            #cut the lines by top and bottom planes
            result, t = LinePlane(lines_corners[i], fitPlane)
            new_point_0 = lines_corners[i].PointAt(t)
            result, t = LinePlane(lines_corners[i], fitPlaneB)
            new_point_1 = lines_corners[i].PointAt(t)
            
            # get extension direction
            l_temp = Line(new_point_0,new_point_1)
            extension_dir = new_point_1-new_point_0
            extension_dir.Unitize()
            l_temp.Transform(to_xy)
            extension_vector = self.get_leveled_vector(l_temp.Direction,_radius)
            extension_dir = extension_dir * extension_vector.Length
            
            # extend the line and update the line
            # lines[i] = Line(new_point_0,new_point_1)
            lines_corners[i] = Line(new_point_0-extension_dir*1,new_point_1+extension_dir*1) 
            
        for i in range(len(lines_corners)):
            lines_horizontal.append(Line(lines[i].From,lines_corners[i].From))
            lines_horizontal.append(Line(lines[i].To,lines_corners[i].To))
        
        ###############################################################################
        # Output
        ###############################################################################
        # for i in lines:
        #     Rhino.RhinoDoc.ActiveDoc.Objects.AddLine(i)
        #Rhino.RhinoDoc.ActiveDoc.Objects.AddPolyline(xA_Notch)
        #Rhino.RhinoDoc.ActiveDoc.Objects.AddPolyline(xB_Notch)
        
        return lines, lines_corners,lines_horizontal, fitPlane, fitPlaneB


    def sort_by_size(self,_p0, _p1):
        sizes = []
        for i in range(len(_p0)):
            sizes.append(_p0[i].GetBoundingBox(True).Diagonal.Length)
        sizes, _c0, _c1 = zip(*sorted(zip(sizes, _p0, _p1), reverse=True))
        
        return _c0, _c1

    def get_ears(self, _c0, _c1, _radius, _notch_type, _union):
                
        ###############################################################################
        # User interface, convert curves toi polylines
        ###############################################################################
        plines0 = []
        plines1 = []
        plines0_offset = []
        plines1_offset = []
        planes0 = []
        planes1 = []
        are_closed = []
        for i in range(len(_c0)):
            plines0.append(self.to_polyline_from_cp(_c0[i]))
            plines1.append(self.to_polyline_from_cp( _c1[i]))
            plines0_offset.append(plines0[-1])
            plines1_offset.append(plines1[-1])
            are_closed.append(True)
        
        ###############################################################################
        # Offset otlines, faces must be planar
        ###############################################################################
        for i in range(len(_c0)):
            plines0_offset[i], plines1_offset[i], are_closed[i] = self.offset_parallelograms(plines0[i], plines1[i], _radius)
        
        ###############################################################################
        # Create notches
        ###############################################################################
        notch_lines_nested = []
        notch_lines_nested_corners = []
        notch_lines_horizontal_nested = []
        for i in range(len(plines0)):
            
            pline_length =  plines0[i].Length
            notch_types = [0]*(plines0[i].Count-1)
            offset_distances = [Vector3d(0,0,0)]*(plines0[i].Count-1)
            
            n = plines0[i].Count - 1
            for j in range( plines0[i].Count-1):
                
                l1 = Line( plines0_offset[i][j], plines1_offset[i][j])
                l2 = Line( plines0[i][j],  plines1[i][j])
                
                dist = l1.ClosestPoint( l2.From, False ).DistanceTo( l2.From ) - _radius
                bisector_dir =  l2.From - ( l1.ClosestPoint( l2.From, False))
                bisector_dir.Unitize()
                bisector_dir *= dist
                offset_distances[j] = bisector_dir
                
                #print(_notch_type)
                if(_notch_type > 1):
                    #print("Hi")
                    shift = 0 if j % 2 == 1 else 0
                    
                    if(pline_length < 300):
                        
                        shift = 0 if j % 2 == 0 else 1
                    
                    notch_types[j] = (3 - shift)
                else:
                    notch_types[j] = _notch_type
                #notch_types[j] = 4
            #prarray
            #print(offset_distances)
            lines, lines_corners,lines_horizontal, plane0, plane1 = self.notches_lines(plines0[i], plines1[i],plines0_offset[i], plines1_offset[i], _radius, notch_types, offset_distances, are_closed[i],i==0)
            notch_lines_nested.append(lines)
            notch_lines_nested_corners.append(lines_corners)
            notch_lines_horizontal_nested.append(lines_horizontal)
            planes0.append(plane0)
            planes1.append(plane1)
            #notch_lines.AddRange(NotchesLines(plines0_offset[i], plines1_offset[i], _radius, notch_types, offset_distances, are_closed))
                
        ###############################################################################
        # Output
        ###############################################################################
        return plines0_offset, plines1_offset, planes0, planes1, are_closed, notch_lines_nested, notch_lines_nested_corners, notch_lines_horizontal_nested

    def get_notch_geometry(self, _c0, _c1, notch_lines_nested, notch_lines_nested_corner, planes0, planes1, radius):
        
        
        #geo = []
        cut_curves0 = []
        cut_curves1 = []
        cut_extrusions = []
        for i in range(len(notch_lines_nested)):
            
            cutter_curves0 = []
            cutter_curves1 = []
            for j in range(len(notch_lines_nested[i])):
                
                # get plane
                p0 = notch_lines_nested[i][j].PointAt(0.5)
                p1 = notch_lines_nested_corner[i][j].ClosestPoint(p0,False)
                xaxis = p0-p1
                zaxis = notch_lines_nested[i][j].Direction
                yaxis = Vector3d.CrossProduct(xaxis,zaxis)
                plane = Plane(p0,xaxis,yaxis)
                
                #construction 5 points for an arc and rectangle profile
                p0_profile = p0 + plane.YAxis*radius
                p1_profile = p1 + plane.YAxis*radius
                p2_profile = p1 - plane.YAxis*radius
                p3_profile = p0 - plane.YAxis*radius
                p4_profile = p0 + plane.XAxis*radius
                p5_profile = p1 - plane.XAxis*radius
                
                # construct PolyCurve
                arc0 = Arc(p0_profile,p4_profile,p3_profile)
                arc1 = Arc(p1_profile,p5_profile,p2_profile)
                polyline0 = Polyline([p0_profile,p1_profile]).ToNurbsCurve()
                polyline1 = Polyline([p2_profile,p3_profile]).ToNurbsCurve()
                
                # geo.append(arc)
                # geo.append(polyline)
                joined_curve = Rhino.Geometry.Curve.JoinCurves([arc0.ToNurbsCurve(),polyline0.ToNurbsCurve(),arc1.ToNurbsCurve(),polyline1.ToNurbsCurve()],0.01)[0]
                joined_curve.Transform(Transform.Translation(notch_lines_nested[i][j].Direction*1))
                
                
                # extrude
                extrusion = Rhino.Geometry.Extrusion.Create(joined_curve.ToNurbsCurve(),notch_lines_nested[i][j].Length*2, True).ToBrep()
                
                
                
                # brep plane
                result, curves0, points = BrepPlane(extrusion, planes0[i], 0.01)
                result, curves1, points = BrepPlane(extrusion, planes1[i], 0.01)
                cutter_curves0.append(curves0[0])
                cutter_curves1.append(curves1[0])
                
                #geo.append(curves0[0])
                #geo.append(curves1[0])
                
                cut_extrusions.append(extrusion)
                #bottom_and_top_cut_curves.append(curves0[0])
            # curve boolean difference
            # continue
            """
            if(i==0):
                crv_difference0 = Rhino.Geometry.Curve.CreateBooleanDifference(_c0[i],cutter_curves0)[0]
                crv_difference1 = Rhino.Geometry.Curve.CreateBooleanDifference(_c1[i],cutter_curves1)[0]
                cut_curves0.append(crv_difference0)
                cut_curves1.append(crv_difference1)
            else:
                cutter_curves0.append(_c0[i])
                cutter_curves1.append(_c1[i])
                crv_difference0 = Rhino.Geometry.Curve.CreateBooleanUnion(cutter_curves0)[0]
                crv_difference1 = Rhino.Geometry.Curve.CreateBooleanUnion(cutter_curves1)[0]
                cut_curves0.append(crv_difference0)
                cut_curves1.append(crv_difference1)
            """
            #align curves
            
        
        return cut_curves0, cut_curves1,cut_extrusions
    
    def RunScript(self, _p0, _p1, _radius,_notch_type, _union):
        
        ###############################################################################
        # Run
        ###############################################################################
        radius = _radius if _radius is not None else 1
        if _p0 and _p1:

            if _p0 == None:
                return
            
            if _p1 == None:
                return
            
            if _p0.DataCount is not _p1.DataCount:
                return
            
            lines =Grasshopper.DataTree[Line]()
            lines_corners = Grasshopper.DataTree[Line]()
            lines_horizontal = Grasshopper.DataTree[Line]()
            offset0 = Grasshopper.DataTree[Polyline]()
            offset1 = Grasshopper.DataTree[Polyline]()
            planes = Grasshopper.DataTree[Plane]()
            #cut_curves0 = Grasshopper.DataTree[Curve]()
            #cut_curves1 = Grasshopper.DataTree[Curve]()
            cut_extrusions = Grasshopper.DataTree[Brep]()
            for i in range(_p0.BranchCount):
                _c0, _c1 = self.sort_by_size(_p0.Branch(i), _p1.Branch(i))
                plines0, plines1, planes0, planes1, are_closed, notch_lines_nested, notch_lines_nested_corners, notch_lines_horizontal_nested = self.get_ears(_c0, _c1,radius,_notch_type, _union)
                lines.AddRange(treehelpers.list_to_tree(notch_lines_nested,i).AllData(),Grasshopper.Kernel.Data.GH_Path(i))
                lines_corners.AddRange(treehelpers.list_to_tree(notch_lines_nested,i).AllData(),Grasshopper.Kernel.Data.GH_Path(i))
                
                for j in range(len(notch_lines_horizontal_nested)):
                    for k in range(0,len(notch_lines_horizontal_nested[j]),2):
                        lines_horizontal.AddRange([notch_lines_horizontal_nested[j][k],notch_lines_horizontal_nested[j][k+1]],Grasshopper.Kernel.Data.GH_Path(i,j,k))
                
                #lines_horizontal.AddRange(treehelpers.list_to_tree(notch_lines_horizontal_nested,i).AllData(),Grasshopper.Kernel.Data.GH_Path(i))
                offset0.AddRange(plines0,Grasshopper.Kernel.Data.GH_Path(i))
                offset1.AddRange(plines1,Grasshopper.Kernel.Data.GH_Path(i))
                planes.Add(Plane(plines0[0][0],planes0[0].ZAxis),Grasshopper.Kernel.Data.GH_Path(i))
                notch_geo = []
                if(_union):
                    cut_curves0_temp, cut_curves1_temp, cut_extrusions_temp = self.get_notch_geometry(_c0, _c1, notch_lines_nested,notch_lines_nested_corners, planes0, planes1, radius+0.00)
                    #cut_curves0.AddRange(cut_curves0_temp,Grasshopper.Kernel.Data.GH_Path(i))
                    #cut_curves1.AddRange(cut_curves1_temp,Grasshopper.Kernel.Data.GH_Path(i))
                    cut_extrusions.AddRange(cut_extrusions_temp,Grasshopper.Kernel.Data.GH_Path(i))

            # _lines = lines
            # _lines_corners = lines_corners
            # _lines_horizontal = lines_horizontal
            # _offset0 = offset0
            # _offset1 = offset1
            # _planes = planes
            # #_cut_curves0 = cut_curves0
            # #_cut_curves1 = cut_curves1
            # _cut_extrusions = cut_extrusions
            return lines, lines_corners, lines_horizontal, offset0, offset1, planes, cut_extrusions
# ---------- end ears ----------
loft_b = Loft_brep(p0=entwine, p1=entwine_2)  # -> simplify(brep); inputs p0: list of Curve, p1: list of Curve
#   port p0: polylines with holes, bottom
#   port p1: polylines with holes, top
#   port brep: lofted and capped brep with holes
# ---------- loft_b: Python ----------
"""get joints ids and connections areas between elements"""

__author__ = "petras vestartas"
__version__ = "2023.03.31"


from ghpythonlib.componentbase import executingcomponent as component
import Rhino.RhinoDoc
import Rhino.Geometry
import Rhino.RhinoMath
from System.Drawing import Color


class connections_zones(component):

    def loft_polylines_with_holes(self, curves0, curves1):
        """Loft polylines with holes
        
        Parameters
        ----------
        curves0 : list[rg.Polyline]
        curves1 : list[rg.Polyline]
        
        Returns
        -------
        rg.Brep
            brep as lofted polylines and cap them
        """
        
        ###############################################################################
        # user input
        ###############################################################################
        
        flag = len(curves0) is not 0 if True else len(curves1) != 0
        if (flag):
            
            curves = []
            curves2 = []
            
            flag0 = len(curves1) == 0
            flag1 = len(curves0) == 0 and len(curves1) != 0
            flag2 = len(curves0) and len(curves1)
            
            if (flag0):
                for i in range(len(curves0)):
                    if (float(i) >= float(len(curves0)) * 0.5):
                        curves2.Add(curves0[i])
                    else:
                        curves.Add(curves0[i])
            elif (flag1):
                for i in range(0, len(curves1), 2):
                    curves.Add(curves1[i])
                    curves2.Add(curves1[i + 1])
            elif (flag2):
                curves = curves0
                curves2 = curves1
            
            curves0 = curves
            curves1 = curves2
        
        
        ###############################################################################
        # Create mesh of the bottom face
        ###############################################################################
        brep_bottom = Rhino.Geometry.Brep.CreatePlanarBreps(curves0, Rhino.RhinoDoc.ActiveDoc.ModelAbsoluteTolerance)[0]
        brep_top = Rhino.Geometry.Brep.CreatePlanarBreps(curves1, Rhino.RhinoDoc.ActiveDoc.ModelAbsoluteTolerance)[0]
        
        ###############################################################################
        # Create lofts
        ###############################################################################
        breps_to_join = [brep_bottom, brep_top]
        for i in range(len(curves0)):
            wall = Rhino.Geometry.Brep.CreateFromLoft([curves0[i],curves1[i]], Rhino.Geometry.Point3d.Unset, Rhino.Geometry.Point3d.Unset, Rhino.Geometry.LoftType.Normal,False)[0]
            breps_to_join.append(wall)
        
        ###############################################################################
        # Join Brep
        ###############################################################################
        solid = Rhino.Geometry.Brep.JoinBreps(breps_to_join, Rhino.RhinoDoc.ActiveDoc.ModelAbsoluteTolerance)[0]
        
        ###############################################################################
        # Because kinked surface can cause problems down stream, Rhino
        # always splits kinked surfaces when adding Breps to the document. Since
        # we are not adding this Brep to the document, lets split the kinked
        # surfaces ourself.
        ###############################################################################
        solid.Faces.SplitKinkyFaces(Rhino.RhinoMath.DefaultAngleTolerance, True)
        
        ###############################################################################
        # The profile curve, created by the input points, is oriented clockwise.
        # Thus when the profile is extruded, the resulting surface will have its
        # normals pointed inwards. So lets check the orientation and, if inwards,
        # flip the face normals.
        ###############################################################################
        if (Rhino.Geometry.BrepSolidOrientation.Inward == solid.SolidOrientation):
            solid.Flip()
        
        for i in range(solid.Faces.Count):
            if(i < 2):
                solid.Faces[i].PerFaceColor = Color.DeepPink#Color.LightGray
            else:
                solid.Faces[i].PerFaceColor = Color.LightGray
        
        return solid
    
    def RunScript(self, _p0, _p1):
        if _p0 and _p1:
            return self.loft_polylines_with_holes(_p0, _p1)
# ---------- end loft_b ----------
sdiff = SolidDifference(BrepsA=loft_b, BrepsB=ears.cut_extrusions)  # disabled

crv_8 = Curve([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])
crv_9 = Curve([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])
crv_10 = Curve(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)
crv_11 = Curve([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])
crv_12 = Curve(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)
crv_13 = Curve([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])
entwine_3 = Entwine(Branch00=crv_9, Branch01=crv_10, Branch02=crv_8, FlattenInputs=True)
entwine_4 = Entwine(Branch00=crv_11, Branch01=crv_12, Branch02=crv_13, FlattenInputs=True)

# ----
# GET CONNECTION ZONES
crv_14 = Curve([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])
crv_15 = Curve([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])
cp_lines = Closest_lines(Polylines=crv_14, Lines=crv_15)  # -> Polylines, Vectors
connection_zones = Connection_zones(polylines=crv_14, vectors=cp_lines.Vectors, output=Slider(2, range=0..10))  # -> polylines_out, cut_types; inputs polylines: tree of Polyline, id: Int32, vectors: tree of Vector3d, joint_types: tree of Int32, three_valence: tree of Int32, adjacency: list of Int32, params: list, scale: list of Int32, output: Int32, search: Int32, extension: list of Int32
#   port polylines: a data-tree of polyline pairs
#   port id: index of xml file, if _polylines are not given
#   port vectors: insertion direction
#   port joint_types: joint type per side, top, bottom, and sides
#   port three_valence: three valance joinery that starts 0 - Vidy, 1 - Annen, and 4 indices current, next, current-neighbor, next-neighbor
#   port adjacency: joint parameters
#   port params: joint parameters
#   port scale: scale of joint, default is [1,1,1]
#   port output: output_type 0 - outlines | 1 - lines | 2 - areas | 3 - volumes | 4 - merged geometry of joints
#   port search: search_type search type 0 - side-to-side, 1 - cross, 2 - both
#   port extension: extension by distance, plates often has [0,0,10], whereas beams [10,10,10], default is [0,0,0]
#   port polylines_out: polyline input
# ---------- connection_zones: Python ----------
"""get joints ids and connections areas between elements"""

__author__ = "petras vestartas"
__version__ = "2023.03.29"


from ghpythonlib.componentbase import executingcomponent as component
# STEP 0 - Installation, anaconda prompt:
# python -m compas_rhino.install
# python -m compas_rhino.install -p compas_wood
# STEP 1 - check the environment name
# import compas_bootstrapper
# print(compas_bootstrapper.ENVIRONMENT_NAME)
# STEP 2 - import proxy from compas.rpc
# https://compas.dev/compas/latest/tutorial/rpc.html#supported-data-types-1
from compas.rpc import Proxy # https://compas.dev/compas/latest/api/compas.rpc.html
proxy = Proxy('compas_wood.joinery') # import module
from compas_rhino import conversions
from ghpythonlib import treehelpers
import Rhino
import Grasshopper as gh

# STEP 3 - start server
#proxy.stop_server()
#proxy.start_server()


class connections_zones(component):
    def RunScript(self, _polylines, _id, _vectors, _joint_types, _three_valence, _adjacency, _params, _scale, _output, _search, _extension):
        # ==============================================================================
        # input
        # ==============================================================================
        output_polylines = []
        if( _polylines.AllData().Count!= 0):
            print("user_input")
            #convert to compas polylines
            for i in _polylines.AllData():
                output_polylines.append(conversions.polyline_to_compas(i))
        else:
            print("xml_input")
            feasible_ids = [1,3,7,10,11,12,14,16,17,18,19,20,21,22,23,24,25,27,28,29,30,31,34,36,37]
            
            # read the xml file and get a data-set
            foldername = (
                proxy.get_cwd()+"/frontend/src/wood/dataset/" 
            )
            
            # read polylines from an xml files
            id = feasible_ids[max(min(24, _id), 0)]
            filename_of_dataset = proxy.get_filenames_of_datasets()[id]
            output_polylines = proxy.read_xml_polylines(foldername, filename_of_dataset)
        
        vectors = []
        if(_vectors != None):
            for i in range (_vectors.BranchCount):
                list = []
                for j in _vectors.Branch(i):
                    list.append(conversions.vector_to_compas(j))
                vectors.append(list)
        
        
        joint_parameters = [
            300, 0.5, 3,   # 1-9 ss_e_ip (side-to-side edge in-plane)
            50, 0.64, 15,  # 10-19 ss_e_op (side-to-side edge out-of-plane)
            450, 0.5, 20,  # 20-29 ts_e_p (top-to-side edge plane)
            300, 0.5, 30,  # 30-39 cr_c_ip (cross cutting in-plane)
            6, 0.95, 40,   # 40-49 tt_e_p  (top-to-top edge plane)
            300, 0.5, 58,  # 50-59 ss_e_r (side-to-side edge rotated)
            300, 1.0, 60   # 60-69 b (boundary)
        ]
        
        for i in range(0, len(_params)):
            joint_parameters[i] = _params[i]
        print(joint_parameters)
        search = id = max(min(2, _search), 0)
        
        scale = [1,1,1]
        for i in range(0, len(_scale)):
            scale[i] = _scale[i]
        
        output_type = _output if _output != None else 4
        
        extension = [0,0,0]
        for i in range(0, len(_extension)):
            extension[i] = _extension[i]
        
        joint_types = []
        if(_joint_types.DataCount != 0):
            treehelpers.tree_to_list(_joint_types)
        
        three_valence = []
        if(_three_valence.DataCount != 0):
            three_valence = treehelpers.tree_to_list(_three_valence)
        
        # ==============================================================================
        # get joints
        # ==============================================================================
        result = proxy.get_connection_zones(
        output_polylines,
        vectors, # output_vectors,
        joint_types, # output_joints_types,
        three_valence, # output_three_valence_element_indices_and_instruction,
        _adjacency, # output_adjacency,
        joint_parameters,
        search,
        scale,
        output_type,
        False,
        extension)
        
        
        
        # ==============================================================================
        # output
        # ==============================================================================
        _polylines_out = gh.DataTree[Rhino.Geometry.Polyline]()
        
        # nest two times the result and add to the tree
        for i in range(0, len(result)):
            for j in range(0, len(result[i])):
                    _polylines_out.Add(conversions.polyline_to_rhino(result[i][j]), gh.Kernel.Data.GH_Path(i))
        
        _cut_type = []
        
        return _polylines_out, _cut_type
# ---------- end connection_zones ----------
boundary = BoundarySurfaces(Edges=connection_zones.polylines_out)
branch = TreeBranch(Tree=connection_zones.polylines_out, Path=Slider(2, range=0..2), MaintainPaths=True)

# ----
# JOINTS
crv_16 = Curve([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])
joints = Joints(polylines=crv_16)  # -> polylines_out, element_pairs, joint_areas, joint_areas_mesh, joint_types, element_neighbors; inputs polylines: tree of Polyline, id: Int32
#   port polylines: a data-tree of polyline pairs
# ---------- joints: Python ----------
"""get joints ids and connections areas between elements"""

__author__ = "petras vestartas"
__version__ = "2023.03.29"


from ghpythonlib.componentbase import executingcomponent as component
# STEP 0 - Installation, anaconda prompt:
# python -m compas_rhino.install
# python -m compas_rhino.install -p compas_wood
# STEP 1 - check the environment name
# import compas_bootstrapper
# print(compas_bootstrapper.ENVIRONMENT_NAME)
# STEP 2 - import proxy from compas.rpc
# https://compas.dev/compas/latest/tutorial/rpc.html#supported-data-types-1
from compas.rpc import Proxy # https://compas.dev/compas/latest/api/compas.rpc.html
proxy = Proxy('compas_wood.joinery') # import module
from compas_rhino import conversions
from ghpythonlib import treehelpers
import Rhino
import Grasshopper as gh

# STEP 3 - start server
#proxy.stop_server()
#proxy.start_server()

class joints(component):
    def RunScript(self, _polylines, _id):
        # ==============================================================================
        # input
        # ==============================================================================
        output_polylines = []
        if( _polylines.AllData().Count!= 0):
            print("user_input")
            #convert to compas polylines
            for i in _polylines.AllData():
                output_polylines.append(conversions.polyline_to_compas(i))
        else:
            print("xml_input")
            feasible_ids = [1,3,7,10,11,12,14,16,17,18,19,20,21,22,23,24,25,27,28,29,30,31,34,36,37]
            
            # read the xml file and get a data-set
            foldername = (
                proxy.get_cwd()+"/frontend/src/wood/dataset/" 
            )
            
            # read polylines from an xml files
            id = feasible_ids[max(min(24, _id), 0)]
            filename_of_dataset = proxy.get_filenames_of_datasets()[id]
            output_polylines = proxy.read_xml_polylines(foldername, filename_of_dataset)
        
        # ==============================================================================
        # get joints
        # ==============================================================================
        element_pairs_list, joint_areas_polylines, joint_types = proxy.joints(output_polylines, 2) 
        
        
        # ==============================================================================
        # output
        # ==============================================================================
        _element_pairs = treehelpers.list_to_tree(element_pairs_list)
        
        # iterate joints add neighbors to individual elements element
        _element_neighbors = gh.DataTree[int]()
        for i in element_pairs_list:
            _element_neighbors.Add(i[1],gh.Kernel.Data.GH_Path(i[0]))
            _element_neighbors.Add(i[0],gh.Kernel.Data.GH_Path(i[1]))
        
        
        _joint_areas = []
        _joint_areas_mesh = []
        for i in joint_areas_polylines:
            polyline = conversions.polyline_to_rhino(i)
            polyline.MergeColinearSegments(0.02, True)
            polyline.CollapseShortSegments(0.02)
            _joint_areas.append(polyline)
            _joint_areas_mesh.append(Rhino.Geometry.Mesh.CreateFromClosedPolyline(polyline))
        
        remap_joint_types = {11: 1, 12: 0, 13: 5, 20: 2, 30: 3, 40: 4}
        _joint_types = []
        for i in joint_types:
            _joint_types.append(remap_joint_types[i])
        
        _polylines_out = []
        for i in output_polylines:
            _polylines_out.append(conversions.polyline_to_rhino(i))
        
        return _polylines_out, _element_pairs, _joint_areas, _joint_areas_mesh, _joint_types, _element_neighbors
# ---------- end joints ----------
partition = PartitionList(List=joints.polylines_out, Size=2)  # -> simplify(Chunks)

# ---- group: Display Joint Types
ss_e_ip_2 = ColourSwatch(SwatchColor=RGB(237, 213, 0))
ss_e_op_2 = ColourSwatch(SwatchColor=RGB(255, 98, 0))
ts_e_p_2 = ColourSwatch(SwatchColor=RGB(0, 191, 255))
tt_e_p_2 = ColourSwatch(SwatchColor=RGB(207, 0, 114))
cr_c_ip_2 = ColourSwatch(SwatchColor=RGB(27, 209, 151))
ss_e_r_2 = ColourSwatch(SwatchColor=RGB(94, 15, 219))
b_2 = ColourSwatch(SwatchColor=RGB(0, 0, 0))
merge = Merge(Data1=ss_e_ip_2, Data2=ss_e_op_2, Data3=ts_e_p_2, Data4=cr_c_ip_2, Data5=tt_e_p_2, Data6=ss_e_r_2, Data7=b_2)
item_2 = ListItem(List=merge, Index=joints.joint_types, Wrap=True)
mcol = MeshColours(Mesh=graft(joints.joint_areas_mesh), Colours=graft(item_2))

# ----
# INTERNALIZED DATA
chevron_surfaces_2 = Chevron_surfaces([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])

input_get_2 = Input_get(Data=chevron_plates.Data)  # -> Plines, Insertion_vectors, Joints_per_face, Three_valence, Adjacency
# C++ - PYBIND11 - COMPAS (RPC) - RHINO PYTHON - 1400 ms
# 
# MEASURE THE TIME FOR:
# compas_wood conversion 1
# c++ code execution for pybind11
# compas_wood conversion 2
# rpc transfer
# compas_wood to rhino conversion
input_set = Input_set(
    polylines=input_get_2.Plines,
    vectors=input_get_2.Insertion_vectors,
    joint_types=input_get_2.Joints_per_face,
    three_valence=input_get_2.Three_valence,
    adjacency=input_get_2.Adjacency)  # -> data; inputs polylines: tree of Polyline, vectors: tree of Vector3d, joint_types: tree of Int32, three_valence: tree of Int32, adjacency: tree of Int32
#   port polylines: a data-tree of polyline pairs
# ---------- input_set: Python ----------
from ghpythonlib.componentbase import executingcomponent as component
import Grasshopper, GhPython
__author__ = "petras"
__version__ = "2023.04.02"


import System
import Rhino
import rhinoscriptsyntax as rs
import ghpythonlib.treehelpers as th
from Rhino.Geometry import Polyline
from Rhino.Geometry import Vector3d
from Rhino.Geometry import Plane

class MyComponent(component):
    
    def get_plane(self, _polyline, _orientation_point):
        
        len = _polyline.Count - 1
        normal = Vector3d(0,0,0)
        
        for i in range((_polyline.Count - 1)):
            num = ((i - 1) + len) % len
            item1 = ((i + 1) + len) % len
            point3d =_polyline[num]
            point3d1 =_polyline[item1]
            item2 = _polyline[i]
            normal = normal + Vector3d.CrossProduct(Vector3d(item2 - point3d), Vector3d(point3d1 - item2))
        
        normal.Unitize()
        plane = Plane(_polyline.CenterPoint(), normal)
        if(plane.DistanceTo(_orientation_point)<0):
            plane.Flip()
        
        return plane
    
    
    
    def RunScript(self, _plines, _insertion_vectors, _joints_per_face, _three_valence, _adjacency):
        
        
        
        plines = []
        planes = []
        if( _plines.DataCount > 0):
            for i in range(_plines.BranchCount):
                plines.append(_plines.Branch(i))
                # create planes for orientation
                
                planes.append(self.get_plane(_plines.Branch(i)[0],_plines.Branch(i)[1][0]))
        
        insertion_vectors =  th.tree_to_list(_insertion_vectors) if _insertion_vectors.DataCount > 0 else []
        joints_per_face =  th.tree_to_list(_joints_per_face) if _joints_per_face.DataCount > 0 else []
        three_valence =  th.tree_to_list(_three_valence) if _three_valence.DataCount > 0 else []
        adjacency = th.tree_to_list(_adjacency) if _adjacency.DataCount > 0 else []
        
        # output
        _data = [[plines,insertion_vectors,joints_per_face,three_valence,adjacency, planes]]
        
        
        # return outputs if you have them; here I try it for you:
        return _data
# ---------- end input_set ----------
solver_2 = Solver(data=input_set, joint_p=joint_parameters)  # -> data; inputs joint_p: list, scale: list of Int32, extension: list of Int32, find: Int32, get: Int32
#   port data: collection of inputs that represent the elements, insertion vectors, joint types and adjacency, use input_set commonent to group these inputs
#   port joint_p: joint parameters
#   port scale: scale of joint, default is [1,1,1]
#   port extension: extension by distance, plates often has [0,0,10], whereas beams [10,10,10], default is [0,0,0]
#   port find: search_type search type 0 - side-to-side, 1 - cross, 2 - both
#   port get: output_type 0 - outlines | 1 - lines | 2 - areas | 3 - volumes | 4 - merged geometry of joints
#   port data: user input_get component to ungroup all the data to the individual data-trees
# ---------- solver_2: Python ----------
"""get joints ids and connections areas between elements"""

__author__ = "petras vestartas"
__version__ = "2023.04.03"
import time

from ghpythonlib.componentbase import executingcomponent as component
# STEP 0 - Installation, anaconda prompt:
# python -m compas_rhino.install
# python -m compas_rhino.install -p compas_wood
# STEP 1 - check the environment name
# import compas_bootstrapper
# print(compas_bootstrapper.ENVIRONMENT_NAME)
# STEP 2 - import proxy from compas.rpc
# https://compas.dev/compas/latest/tutorial/rpc.html#supported-data-types-1
from compas.rpc import Proxy # https://compas.dev/compas/latest/api/compas.rpc.html
proxy = Proxy('compas_wood.joinery') # import module
from compas_rhino import conversions
from ghpythonlib import treehelpers
import Rhino
import Grasshopper
from Rhino.Geometry import Polyline
# STEP 3 - start server
#proxy.stop_server()
#proxy.start_server()


class connections_zones(component):
    def RunScript(self, _data, _join_p, _scale, _extension, _find, _get):
        # ==============================================================================
        # input
        # ==============================================================================
        if(_data is None):
            return
        
        output_polylines = []
        if( _data[0] != 0):
            #convert to compas polylines
            for i in _data[0]:
                for j in i:
                    output_polylines.append(conversions.polyline_to_compas(j))
        
        vectors = []
        if(_data[1] != None):
            for i in _data[1]:
                list = []
                for j in i:
                    list.append(conversions.vector_to_compas(j))
                vectors.append(list)
        
        joint_parameters = [
            300, 0.5, 3,   # 1-9 ss_e_ip (side-to-side edge in-plane)
            50, 0.64, 15,  # 10-19 ss_e_op (side-to-side edge out-of-plane)
            450, 0.5, 20,  # 20-29 ts_e_p (top-to-side edge plane)
            300, 0.5, 30,  # 30-39 cr_c_ip (cross cutting in-plane)
            6, 0.95, 40,   # 40-49 tt_e_p  (top-to-top edge plane)
            300, 0.5, 58,  # 50-59 ss_e_r (side-to-side edge rotated)
            300, 1.0, 60   # 60-69 b (boundary)
        ]
        
        for i in range(0, len(_join_p)):
            joint_parameters[i] = _join_p[i]
        
        search = id = max(min(2, _find), 0)
        
        scale = [1,1,1]
        for i in range(0, len(_scale)):
            scale[i] = _scale[i]
        
        output_type = _get if _get != None else 4
        
        extension = [0,0,0]
        for i in range(0, len(_extension)):
            extension[i] = _extension[i]
        
        
        adjacency = []
        if(len(_data[4])>0):
            for i in _data[4]:
                for j in i:
                    adjacency.append(j)
        
        # ==============================================================================
        # get joints
        # ==============================================================================
        start_time = time.time()
        result = proxy.get_connection_zones(
        output_polylines,
        vectors, # output_vectors,
        _data[2], # output_joints_types,
        _data[3], # output_three_valence_element_indices_and_instruction,
        adjacency, # output_adjacency,
        joint_parameters,
        search,
        scale,
        output_type,
        False,
        extension)
        print(
             "\n______________________________________ %s ms ______________________________________"
            % round((time.time() - start_time) * 1000.0, 2)
        )
        
        
        
        # ==============================================================================
        # output
        # ==============================================================================
        _plines = []
        
        # nest two times the result and add to the tree
        for i in range(0, len(result)):
            list = []
            for j in range(0, len(result[i])):
                    list.append(conversions.polyline_to_rhino(result[i][j]))
            _plines.append(list)
        _cuts = []
        _data = [[_plines,_data[1],_data[2],_data[3],_data[4],_data[5],_cuts]]
        
        return _data
# ---------- end solver_2 ----------
# Add files for the full data-set and check again
# 
# VSCode does not have it now
input_get_3 = Input_get(data=solver_2)  # -> plines, insertion_vectors, joints_per_face, three_valence, adjacency
#   port data: collection of inputs that represent the elements, insertion vectors, joint types and adjacency, use input_set commonent to group these inputs
# ---------- input_get_3: Python ----------
from ghpythonlib.componentbase import executingcomponent as component
import Grasshopper, GhPython
import System

__author__ = "petras"
__version__ = "2023.04.02"

import ghpythonlib.treehelpers as th
from Rhino.Geometry import Polyline
import Rhino
import rhinoscriptsyntax as rs

class MyComponent(component):
    
    def RunScript(self, _data):
        
        if(_data is None):
            return
        
        _plines =  Grasshopper.DataTree[Polyline]()
        for i in range(len(_data[0])):
            _plines.AddRange(_data[0][i],Grasshopper.Kernel.Data.GH_Path(i))
        
        
        _insertion_vectors =  th.list_to_tree(_data[1])
        _joints_per_face =  th.list_to_tree(_data[2])
        _three_valence = th.list_to_tree(_data[3])
        _adjacency =th.list_to_tree(_data[4])
        
        # return outputs if you have them; here I try it for you:
        return (_plines, _insertion_vectors, _joints_per_face, _three_valence, _adjacency)
# ---------- end input_get_3 ----------

# ----
# LOFT TO BREP OR MESH
loft = Loft(p0=entwine_3, p1=entwine_4)  # -> brep; inputs p0: list of Curve, p1: list of Curve; same code as loft_b
loft_2 = Loft(p0=entwine_3, p1=entwine_4)  # -> mesh; inputs p0: list of Curve, p1: list of Curve
#   port p0: polylines with holes, bottom
#   port p1: polylines with holes, top
#   port mesh: lofted and capped mesh with holes
# ---------- loft_2: Python ----------
"""get joints ids and connections areas between elements"""

__author__ = "petras vestartas"
__version__ = "2023.03.31"

from ghpythonlib.componentbase import executingcomponent as component
import Rhino.RhinoDoc
import Rhino.Geometry
import System
from System.Drawing import Color

class connections_zones(component):


    def to_polyline_from_cp(self, curve):
        
        polyline = Rhino.Geometry.Polyline() 
        result, polyline1 = curve.TryGetPolyline()
        
        if (result == False):
            
            nurbsCurve = curve.ToNurbsCurve()  
            point3dArray = []
            
            for i in range(nurbsCurve.Points.Count):
                result, pt = nurbsCurve.Points.GetPoint(i)
                point3dArray.append(pt)
            
            polyline1 = Rhino.Geometry.Polyline(point3dArray)  
            nurbsCurve = polyline1.ToNurbsCurve()  
            result, polyline1 = nurbsCurve.TryGetPolyline()  
            
            polyline1.CollapseShortSegments(0.01) 
            
            polyline1 = Rhino.Geometry.Polyline(polyline1)  
            polyline = polyline1  
            
        else:
            polyline1.CollapseShortSegments(0.01)  
            polyline = polyline1  
        
        return polyline  

    def loft_polylines_with_holes(self, curves0, curves1):
        """Loft polylines with holes
        
        Parameters
        ----------
        curves0 : list[rg.Polyline]
        curves1 : list[rg.Polyline]
        
        Returns
        -------
        rg.Mesh
            mesh as lofted polylines and cap them
        """
        
        ###############################################################################
        # user input
        ###############################################################################
        
        flag = len(curves0) is not 0 if True else len(curves1) != 0
        if (flag):
            
            curves = []
            curves2 = []
            
            flag0 = len(curves1) == 0
            flag1 = len(curves0) == 0 and len(curves1) != 0
            flag2 = len(curves0) and len(curves1)
            
            if (flag0):
                for i in range(len(curves0)):
                    if (float(i) >= float(len(curves0)) * 0.5):
                        curves2.Add(curves0[i])
                    else:
                        curves.Add(curves0[i])
            elif (flag1):
                for i in range(0, len(curves1), 2):
                    curves.Add(curves1[i])
                    curves2.Add(curves1[i + 1])
            elif (flag2):
                curves = curves0
                curves2 = curves1
            
            curves0 = curves
            curves1 = curves2
        
        ###############################################################################
        # sort curves which one is border and which ones are holes
        ###############################################################################
        length = -1.0
        border_id = -1
        count = 0
        numArray = []
        for curve in curves0:
            diagonal = curve.GetBoundingBox(True).Diagonal
            temp_length = diagonal.Length
            if temp_length > length:
                length = temp_length
                border_id = count
            count=count+1
        
        
        border0 = self.to_polyline_from_cp(curves0[border_id])
        border1 = self.to_polyline_from_cp(curves1[border_id])
        holes0 = []
        holes1 = []
        for i in range(curves0.Count):
            if (i != border_id):
                holes0.Add(curves0[i])
                holes1.Add(curves1[i])
        
        ###############################################################################
        # Create mesh of the bottom face
        ###############################################################################
        mesh_bottom = Rhino.Geometry.Mesh.CreatePatch(border0, Rhino.RhinoDoc.ActiveDoc.ModelAngleToleranceRadians, None, holes0, None, None, True, 1)
        
        ###############################################################################
        # Convert closed polylines to open ones
        ###############################################################################
        
        point_3d_array = []
        for i in range(len(mesh_bottom.Vertices)):
            point_3d_array.append(mesh_bottom.Vertices.Point3dAt(i))
        
        open_curve_points_0 = []
        open_curve_points_1 = []
        
        for i in range(border0.Count-1):
            open_curve_points_0.append( border0[i])
            open_curve_points_1.append( border1[i])
        
        for i in range(holes0.Count):
            holes0_polyline = self.to_polyline_from_cp(holes0[i]) 
            holes1_polyline = self.to_polyline_from_cp(holes1[i]) 
            for j in range(len(holes0_polyline)-1):
                open_curve_points_0.append(holes0_polyline[j])
                open_curve_points_1.append(holes1_polyline[j])
        
        ###############################################################################
        # Using the bottom mesh vertices create the top mesh f
        ###############################################################################
        points_to_sort_new = self.sort_set_of_points(open_curve_points_0, point_3d_array)
        mesh_top = mesh_bottom.DuplicateMesh()
        
        for i in range(len(points_to_sort_new)):
            mesh_top.Vertices.SetVertex(i, open_curve_points_1[points_to_sort_new[i]])
        
        ###############################################################################
        # Merge the top and bottom mesh into one and add sides
        ###############################################################################
        mesh = Rhino.Geometry.Mesh()
        mesh.Append(mesh_bottom)
        mesh.Append(mesh_top)
        
        count = mesh_bottom.Vertices.Count
        for p in range (mesh_bottom.TopologyEdges.Count):
            
            if (mesh_bottom.TopologyEdges.GetConnectedFaces(p).Length == 1):
                topologyVertices = mesh_bottom.TopologyEdges.GetTopologyVertices(p)
                mesh.Faces.AddFace(topologyVertices.I, topologyVertices.J, topologyVertices.J + count, topologyVertices.I + count)
        
        mesh.UnifyNormals()
        mesh.Ngons.AddPlanarNgons(Rhino.RhinoDoc.ActiveDoc.ModelAbsoluteTolerance * 1, 3, 1, True)
        
        ###############################################################################
        # Unweld ngons meshes
        ###############################################################################
        unwelded_ngon_mesh = Rhino.Geometry.Mesh()
        count = 0
        for ngonAndFacesEnumerable in mesh.GetNgonAndFacesEnumerable():
            
            faces = []
            for j in ngonAndFacesEnumerable.FaceIndexList():
                faces.append(System.Int32(j))
            
            temp_ngon_mesh = mesh.DuplicateMesh().Faces.ExtractFaces(faces)
            
            #add colors
            if(count<2):
                temp_ngon_mesh.VertexColors.CreateMonotoneMesh(Color.DeepPink)
            else:
                temp_ngon_mesh.VertexColors.CreateMonotoneMesh(Color.LightGray)
            
            unwelded_ngon_mesh.Append(temp_ngon_mesh)
            count = count + 1
        
        ###############################################################################
        # Output
        ###############################################################################
        unwelded_ngon_mesh.RebuildNormals()
        return unwelded_ngon_mesh




    def sort_set_of_points(self, points_to_sort, guide_points):
        """Sort one array of point by an another point array
        
        use it like this: 
        #points_to_sort_new = []
        #for i in points_to_sort_ids:
        #    points_to_sort_new.append(points_to_sort[i])
        
        Parameters
        ----------
        points_to_sort : list[rg.Point3d]
        guide_points : list[rg.Point3d]
        
        Returns
        -------
        list[int]
            the list of indices of the sorted array
        """
        
        # create a copy
        points_to_sort_copy = []
        for i in points_to_sort:
            points_to_sort_copy.append(Rhino.Geometry.Point3d(i))
        
        guide_points_copy = []
        for i in guide_points:
            guide_points_copy.append(Rhino.Geometry.Point3d(i))
        
        # make indices of points
        points_to_sort_ids = list(range(0,len(points_to_sort_copy)))
        guide_points_ids = list(range(0,len(guide_points_copy)))
        
        # sort both lists by xyz coordinates together with indices
        points_to_sort_copy, points_to_sort_ids = zip(*sorted(zip(points_to_sort_copy, points_to_sort_ids)))
        guide_points_copy, guide_points_ids = zip(*sorted(zip(guide_points_copy, guide_points_ids)))
        
        # sort guide points indices and order the points to sort indec
        guide_points_ids, points_to_sort_ids = zip(*sorted(zip(guide_points_ids, points_to_sort_ids)))
        
        # can be used like this:
        #points_to_sort_new = []
        #for i in points_to_sort_ids:
        #    points_to_sort_new.append(points_to_sort[i])
        
        return points_to_sort_ids

    def RunScript(self, _p0, _p1):
        if _p0 and _p1:
            return self.loft_polylines_with_holes(_p0, _p1)
# ---------- end loft_2 ----------

assembly = Assembly(data=input_set, dir=chevron_plates.Dir, t=Slider(3.1, range=0..50))  # inputs dir: list of Line, n: Int32
#   port data: collection of inputs that represent the elements, insertion vectors, joint types and adjacency, use input_set commonent to group these inputs
# ---------- assembly: Python ----------
__author__ = "petras"
__version__ = "2023.04.02"

from ghpythonlib.componentbase import executingcomponent as component
import Grasshopper, GhPython
import System
import Rhino
import rhinoscriptsyntax as rs


import rhinoscriptsyntax as rs
import Rhino.Geometry as rg
from Rhino.Geometry import BoundingBox
from Rhino.Geometry import Point3d
from Rhino.Geometry import Plane
from Rhino.Geometry import Polyline
from Rhino.Geometry import Vector3d
from Rhino.Geometry import Line
from Rhino.Geometry import TextEntity
from Rhino.Geometry import Transform
from System.Drawing import Color
import math

class MyComponent(component):
    
    bbox = BoundingBox.Unset
    lines = []
    insertion_vectors_current = []
    joint_per_face_current_text_entity = []
    polylines = []
    
    def DrawViewportWires(self, args):
        try:
            plane = Plane.WorldXY
            for line in self.lines:
                args.Display.DrawLineArrow(line, Color.FromArgb(207, 0, 90), 2, 100)
            for polyline in self.polylines:
                args.Display.DrawPolyline(polyline, Color.FromArgb(207, 0, 90), 2)
            for insertionVectorsCurrent in self.insertion_vectors_current:
                if(insertionVectorsCurrent.Length<0.05):
                    continue
                args.Display.DrawLine(insertionVectorsCurrent, Color.FromArgb(0, 0, 0), 5)
            for jointPerFaceCurrent in self.joint_per_face_current_text_entity:
                result, plane = Rhino.RhinoDoc.ActiveDoc.Views.ActiveView.ActiveViewport.GetCameraFrame()
                plane.Origin=(jointPerFaceCurrent.Plane.Origin)
                args.Display.Draw3dText(jointPerFaceCurrent.PlainText, jointPerFaceCurrent.MaskColor, plane, jointPerFaceCurrent.TextHeight, "Arial", False, False,Rhino.DocObjects.TextHorizontalAlignment.Center, Rhino.DocObjects.TextVerticalAlignment.BottomOfTop)
        except Exception, e:
            System.Windows.Forms.MessageBox.Show(str(e), "script error")
    
    def get_ClippingBox(self):
        return Rhino.Geometry.BoundingBox()
    
    
            
    def display_insersion_sequence(self, _data, _lines, _n, _t):
        
        text_size = 50
        line_scale = 300
        
        ###############################################################################
        # input
        ###############################################################################
        self.bbox = BoundingBox.Unset
        self.lines =  _lines if len(_lines) > 0 else [Line(Point3d(0,0,0),Point3d(0,0,1))]
        self.insertion_vectors_current =  []
        self.joint_per_face_current_text_entity = []
        self.polylines =  []
        
        group_count = _n if _n is not None else 4
        t = _t if _t is not None else 0.0
        item = self.lines[0]
        self.bbox = self.lines[0].BoundingBox
        
        ###############################################################################
        # process
        ###############################################################################
        for i in range(1,len(self.lines)) :
            self.bbox.Union(self.lines[i].BoundingBox)
        
        for i in range(0,int(math.floor(t)))  :
            for j in range(group_count) :
                for pline in _data[0][i * group_count + j]:
                    self.polylines.append(pline) 
        
        if (t % 1 > 0):
            
            id2 = int(math.floor(t))
            polylines_current = []
            
            for i in range(group_count):
                for pline in (_data[0][id2 * group_count + i]):
                    polylines_current.append(pline)
            
            for m in range(len(polylines_current)) :
                
                item = self.lines[id2]
                line_from = item.From
                item = self.lines[id2]
                to = line_from - item.To
                
                polyline = polylines_current[m].Duplicate()
                polyline.Transform(Transform.Translation(to * (1 - t % 1)))
                polylines_current[m] = polyline
            
            for i in polylines_current:
                self.polylines.append(i)
            
            for n in range(0,polylines_current.Count,2) :
                
                point3ds =  [polylines_current[n].CenterPoint(),  polylines_current[n + 1].CenterPoint()]
                
                for o in range(0, polylines_current[n].Count - 1):
                    p0 = (polylines_current[n][o] + polylines_current[n][o + 1]) * 0.5
                    p1 = (polylines_current[n + 1][o] + polylines_current[n + 1][o + 1]) * 0.5
                    pmid = (p0+p1)*0.5
                    point3ds.append(pmid)
                
                for p in range(len(point3ds)):
                    
                    face_vectors = _data[1][id2 * 4 + int(n * 0.5)][p]
                    
                    if (face_vectors == Vector3d.Zero)  :
                        face_vectors =  Vector3d(0, 0, 0.0001)
                    
                    self.insertion_vectors_current.Add( Line(point3ds[p]+ (face_vectors * line_scale*0.25), point3ds[p] + (face_vectors * line_scale)))
                    text = str(_data[2][int(n * 0.5)][p])
                    textEntity = TextEntity()
                    textEntity.Plane=( Plane(point3ds[p], Vector3d.ZAxis))
                    textEntity.PlainText=(text)
                    
                    
                    if(_data[2][int(n * 0.5)][p] > 0):
                        textEntity.MaskColor=(Color.FromArgb( 0,0,0))
                        textEntity.TextHeight=((float)(text_size))
                    else:
                        textEntity.MaskColor=(Color.FromArgb( 100,100,100))
                        textEntity.TextHeight=((float)(text_size*0.5))
                    self.joint_per_face_current_text_entity.Add(textEntity)

        # return outputs if you have them here I try it for you:
        return 
    
    def RunScript(self, _data, _dir, _n, _t):
        self.display_insersion_sequence(_data, _dir, _n, _t)
# ---------- end assembly ----------

# ---- group: Element Neighbors
number_slider_2 = Slider(0, range=0..8)
branch_2 = TreeBranch(Tree=partition, Path=number_slider_2, MaintainPaths=True)
branch_3 = TreeBranch(Tree=joints.element_neighbors, Path=number_slider_2, MaintainPaths=True)
branch_4 = TreeBranch(Tree=partition, Path=branch_3, MaintainPaths=True)
boundary_2 = BoundarySurfaces(Edges=branch_2)
boundary_3 = BoundarySurfaces(Edges=branch_4)
mcol_2 = MeshColours(Mesh=boundary_3, Colours=ColourSwatch(SwatchColor=RGB(0, 170, 255)))
mcol_3 = MeshColours(Mesh=boundary_2, Colours=ColourSwatch(SwatchColor=RGB(255, 0, 161)))

# ---- group: Element Pairs
branch_5 = TreeBranch(Tree=simplify(joints.element_pairs), Path=Slider(5, range=0..8), MaintainPaths=True)
item_3 = ListItem(List=branch_5, Index=[0, 1], Wrap=True)
branch_6 = TreeBranch(Tree=partition, Path=item_3, MaintainPaths=True)
bang = ExplodeTree(Data=branch_6)  # -> Branch0, Branch1
boundary_4 = BoundarySurfaces(Edges=bang.Branch0)
boundary_5 = BoundarySurfaces(Edges=bang.Branch1)
# [  ] - 9 Components to rewrite
# [  ] - separate files into example files
# [  ] - document components on the github
# [  ] - add folding components: a) hex divide and profile extrude
mcol_4 = MeshColours(Mesh=boundary_4, Colours=ColourSwatch(SwatchColor=RGB(255, 0, 161)))
mcol_5 = MeshColours(Mesh=boundary_5, Colours=ColourSwatch(SwatchColor=RGB(0, 170, 255)))

# ----
booleandifference = BooleanDifference(A=loft_b, B=ears.cut_extrusions)  # -> result; inputs A: list of Brep, B: list of Brep
# ---------- booleandifference: Python ----------
import Rhino
a=[]
tol = Rhino.RhinoDoc.ActiveDoc.ModelAbsoluteTolerance
breps = Rhino.Geometry.Brep.CreateBooleanDifference(A,B, tol)
result=[brep for brep in breps]
# ---------- end booleandifference ----------

xy = XYPlane(Origin=Point(0, 0, 0))
orient_data = Orient_data(data=solver_2, planes=xy, ids=Slider(517, range=0..1000))  # -> plines_o; inputs planes: list of Plane, ids: list of Int32
#   port data: collection of inputs that represent the elements, insertion vectors, joint types and adjacency, use input_set commonent to group these inputs
#   port planes: target planes for orientation of elements
#   port ids: indices to orient only certain elements
#   port plines_o: oriented outlines using plane to plane transformation
# ---------- orient_data: Python ----------
__author__ = "petras"
__version__ = "2023.04.02"

import System
import Rhino
import rhinoscriptsyntax as rs
import ghpythonlib.treehelpers as th
from Rhino.Geometry import Polyline
from Rhino.Geometry import Transform
from Rhino.Geometry import Vector3d
#import Grasshopper
from Rhino.Geometry import Plane

from ghpythonlib.componentbase import executingcomponent as component
import Grasshopper, GhPython
import System
import Rhino
import rhinoscriptsyntax as rs

class MyComponent(component):
    
    def get_plane(self, _polyline, _orientation_point):
        
        len = _polyline.Count - 1
        normal = Vector3d(0,0,0)
        
        for i in range((_polyline.Count - 1)):
            num = ((i - 1) + len) % len
            item1 = ((i + 1) + len) % len
            point3d =_polyline[num]
            point3d1 =_polyline[item1]
            item2 = _polyline[i]
            normal = normal + Vector3d.CrossProduct(Vector3d(item2 - point3d), Vector3d(point3d1 - item2))
        
        normal.Unitize()
        plane = Plane(_polyline.CenterPoint(), normal)
        if(plane.DistanceTo(_orientation_point)<0):
            plane.Flip()
        
        return plane
    
    def RunScript(self, _data, _planes, _ids):
        
        if(_data is None):
            return
        
        target_planes = _planes if len(_planes) > 0 else [Plane.WorldXY]
        _plines =  Grasshopper.DataTree[Polyline]()
        
        if(len(_ids)==0 or len(_planes) != len(_ids)):
            
            for i in range(len(_data[0])):
                xform = Transform.PlaneToPlane(self.get_plane(_data[0][i][0],_data[0][i][1][0]),target_planes[i%len(target_planes)])
                    
                for j in range(len(_data[0][i])):
                    polyline_copy = Polyline(_data[0][i][j])
                    polyline_copy.Transform(xform)
                    _plines.Add(polyline_copy,Grasshopper.Kernel.Data.GH_Path(i))
        else:
            total_element_count = len(_data[0])
            for i in range(len(_ids)):
                local_id = _ids[i]
                if(local_id >= total_element_count or local_id < 0 ):
                    continue
                xform = Transform.PlaneToPlane(self.get_plane(_data[0][local_id][0],_data[0][local_id][1][0]),target_planes[i%len(target_planes)])
                for j in range(len(_data[0][local_id])):
                    polyline_copy = Polyline(_data[0][local_id][j])
                    polyline_copy.Transform(xform)
                    _plines.Add(polyline_copy,Grasshopper.Kernel.Data.GH_Path(i))
        
        _plines_oriented = _plines
        
        """
        _data_xform = _plines
        _insertion_vectors =  th.list_to_tree(_data[1])
        _joints_per_face =  th.list_to_tree(_data[2])
        _three_valence = th.list_to_tree(_data[3])
        _adjacency =th.list_to_tree(_data[4])
        """
        
        # return outputs if you have them; here I try it for you:
        return _plines_oriented
# ---------- end orient_data ----------

panel_2 = Panel(input_get_3.plines)
python = GhPythonScript()  # -> Out, _f, _f_pl, _f_id, _e, _e_pl, _e_id
python_2 = GhPythonScript()  # -> Out, _data, _dir
python_3 = GhPythonScript()  # -> Out, _mesh

# ---- group: chevron
chevron_2 = Chevron(
    U_divisions=Slider(4, range=1..20),
    V_division_dist=Slider(900, range=900..1000),
    Shift=Slider(0.5, range=0.5..1),
    Scale=Slider(0.05799, range=0.05..0.06))

# ---- group: connectors
connectors = Connectors(
    Face_positions=Slider(0, range=-10..10),
    Face_thickness=Slider(4, range=0..10),
    Divisions=Slider(2, range=1..10),
    Division_len=Slider(15, range=1..100),
    Rect_width=Slider(12, range=-20..20),
    Rect_height=Slider(12, range=-20..20),
    Rect_thickness=Slider(1, range=1..2))  # -> F, F_pl, F_id, E, E_pl, E_id

# ---- group: chevron_plates
chevron_plates_2 = Chevron_plates(
    Edge_rotation=Slider(1, range=0..10),
    Edge_offset=Slider(0.5, range=0..2.5),
    Box_height=Slider(760, range=100..1000),
    Top_plate_inlet=Slider(80, range=0..100),
    Plate_thickness=Slider(40, range=1..40),
    Ortho=True)  # -> Data, Dir

# ----
python_4 = GhPythonScript()  # -> Out, _polylines_out, _joints_types_out
python_5 = GhPythonScript()  # -> Out, _polylines_out, _vectors
cp_lines_2 = Closest_indexed_points()  # -> Polylines, Ints
cp_lines_3 = Closest_lines()  # -> Polylines, Vectors

ss_e_ip_3 = Panel("""300
0.5
3""")
cr_c_ip_3 = Panel("""300
0.5
30""")
tt_e_p_3 = Panel("""6
0.95
40""")
ss_e_r_3 = Panel("""300
0.5
58""")
ss_e_op_3 = Panel("""50
0.64
15""")
ts_e_p_3 = Panel("""450
0.5
20""")
b_3 = Panel("""300
1.0
60""")

# ----
# JOINT PARAMETERS
joint_parameters_2 = Joint_parameters(ss_e_ip=ss_e_ip_3, ss_e_op=ss_e_op_3, ts_e_p=ts_e_p_3, cr_c_ip=cr_c_ip_3, tt_e_p=tt_e_p_3, ss_e_r=ss_e_r_3, b=b_3)  # -> joint_p; inputs ss_e_ip: list, ss_e_op: list, ts_e_p: list, cr_c_ip: list, tt_e_p: list, ss_e_r: list, b: list; same code as joint_parameters

panel_3 = Panel(joint_parameters_2)
